# Dynamo graph K-Materials_Creation.dyn (Dynamo 2.6.2.15705)
# packages: archi-lab.net 2022.210.2218, Genius Loci 2021.9.7

# group: INPUT
file_path = Filename(".\K_MasterMaterials.csv")  # graph input
code_block = CodeBlock { "NAME"; }

byFilePath = archilab.Csv.Csv.ByFilePath(filePath=file_path)
valuesByHeaderName = archilab.Csv.Csv.ValuesByHeaderName(csv=byFilePath, header=code_block)
create = archilab.Revit.Elements.Materials.Create(name=valuesByHeaderName)

# group (continued): INPUT
clear_list = Custom[Clear List](input=create)  # package archi-lab.net; This node will remove all Null and Empty Lists from any list.

# group: LCA EMBODIED CARBON
code_block_2 = CodeBlock { "MCO_XXX_M_LCA_EC"; }
code_block_3 = CodeBlock { "EMBODIED CARBON"; }
valuesByHeaderName_2 = archilab.Csv.Csv.ValuesByHeaderName(csv=byFilePath, header=code_block_3)
setParameterByName = Element.SetParameterByName(element=clear_list, parameterName=code_block_2, value=valuesByHeaderName_2)

code_block_4 = CodeBlock { "EC_Calcs"; }
select_parameter_type = ParameterType("Text")
select_builtin_parameter_group = BuiltInParameterGroup("PG_GREEN_BUILDING")
categories = Categories("OST_Materials")
create_shared_parameter = Custom[Create Shared Parameter](ParameterName=code_block_2, GroupName=code_block_4, ParameterType=select_parameter_type, ParameterGroup=select_builtin_parameter_group, category=categories)  # package Genius Loci; Create shared parameters in the shared parameter file and then add it to the project. It is possible to use an existing GUID to recreate an identical shared parameter in a new SP file. Or use the GUID input to simply add the shared parameters to the project. Inspired by archilab

# group: LCA DENSITY
code_block_5 = CodeBlock { "MCO_XXX_M_LCA_DENSITY"; }
code_block_6 = CodeBlock { "DENSITY"; }
valuesByHeaderName_3 = archilab.Csv.Csv.ValuesByHeaderName(csv=byFilePath, header=code_block_6)
setParameterByName_2 = Element.SetParameterByName(element=clear_list, parameterName=code_block_5, value=valuesByHeaderName_3)

code_block_7 = CodeBlock { "EC_Calcs"; }
select_parameter_type_2 = ParameterType("Text")
select_builtin_parameter_group_2 = BuiltInParameterGroup("PG_GREEN_BUILDING")
categories_2 = Categories("OST_Materials")
create_shared_parameter_2 = Custom[Create Shared Parameter](ParameterName=code_block_5, GroupName=code_block_7, ParameterType=select_parameter_type_2, ParameterGroup=select_builtin_parameter_group_2, category=categories_2)
